# Grasshopper definition 160925_PE_points.gh (Grasshopper 0.9.76)

line = Line([Line((-6.782078056, -19.06538891, 0), (14.68115942, -23.3580364, 0)), Line((12.47980173, -13.01165526, 0), (8.07708635, -40.63869427, 0)), Line((17.76306019, -30.95272043, 0), (-14.37676209, -28.64129486, 0)), Line((8.847561542, -14.44253776, 0), (-2.379362677, -37.22658985, 0)), Line((-7.772689017, -23.57817217, 0), (16.55231346, -26.8802087, 0))])
panel = Panel("""1,2
2,1""")
panel_2 = Panel("""2.0,2.0,0.0
-0.5,4.0,0.0""")
line_length = Panel("""3.2
5.1
6.3
4.2""")
panel_3 = Panel("""0
1
2
3""")
linelist = Curve(line)
lng = ListLength(List=linelist)
# Point:indicate a position in space
# Line:length,direction,position
# Point
# two ends of the line
# the intersection of two lines
# the meeting of lines at the corner of a space or volumn
# the center of field
md_slider = MDSlider(
    slider_value=Point(0.5132578379, 0.5396976122, 0.5),
    SliderMode=0,
    x_domain=Domain(-100, 100),
    y_domain=Domain(-100, 100),
    z_domain=Domain(0, 1))
subtraction = Subtraction(A=lng, B="1")
series = Series(Start=0, Step=1, Count=subtraction)
startpoint = Point(panel)
vec = Vector(panel_2)
startpoint_2 = Point(md_slider)
line_length_2 = Number(line_length)
addition = Addition(A=series, B="1")
int = Integer(panel_3)
addition_2 = Addition(A=startpoint, B=vec)
item = ListItem(List=linelist, Index=series, Wrap=False)  # -> simplify(graft(Item))
item_2 = ListItem(List=["1,0", "0,1", "-1,0", "0,-1"], Index=int, Wrap=True)
shift = ShiftList(List=linelist, Shift=addition, Wrap=False)  # -> simplify(List)
endpoint = Point(addition_2)
item_3 = ListItem(List=line_length_2, Index=0, Wrap=True)
X = UnitX(Factor=1)
basicvector = Vector(item_2)
end = EndPoints(Curve=item)  # -> Start, End
end_2 = EndPoints(Curve=shift)  # -> Start, End
ln = Line(StartPoint=startpoint, EndPoint=addition_2)
merge = Merge(Data1=Slider(0.52, range=0..100), Data2=Slider(2.4, range=0..100))
merge_2 = Merge(Data1=Slider(7.61, range=0..100), Data2=Slider(6.19, range=0..100))
item_4 = ListItem(List=startpoint, Index="0", Wrap=True)  # -> Item, Item1
item_5 = ListItem(List=endpoint, Index="0", Wrap=True)  # -> Item, Item1
amp = Amplitude(Vector=X, Amplitude=item_3)
firstpt0 = Point(end.Start)
firstpt1 = Point(end_2.Start)
endpt0 = Point(end.End)
endpt1 = Point(end_2.End)
line_2 = LineSDL(Start=startpoint_2, Direction=X, Length=item_3)
complex = ComplexComponents(Complex=startpoint_2)  # -> Real, Imaginary
pt = PointOriented(BasePlane=startpoint_2, UComponent=merge, VComponent=merge_2, WComponent=0)
complex_2 = ComplexComponents(Complex=amp)  # -> Real, Imaginary
firstpt1_2 = Point(firstpt1)
firstpt0_2 = Point(firstpt0)
endpt0_2 = Point(endpt0)
endpt1_2 = Point(endpt1)
complex_3 = CreateComplex(Real=complex.Real, Imaginary=complex.Imaginary)
complex_4 = CreateComplex(Real=complex_2.Real, Imaginary=complex_2.Imaginary)
item_6 = ListItem(List=pt, Index=0, Wrap=True)  # -> Item, Item1
complex_5 = ComplexComponents(Complex=firstpt1_2)  # -> Real, Imaginary
complex_6 = ComplexComponents(Complex=endpt1_2)  # -> Real, Imaginary
complex_7 = ComplexComponents(Complex=endpt0_2)  # -> Real, Imaginary
complex_8 = ComplexComponents(Complex=firstpt0_2)  # -> Real, Imaginary
points = PointList(Points=flatten(firstpt0_2), Size=Slider(2, range=0..100))
X_2 = UnitX(Factor=1)
Y = UnitY(Factor=1)
addition_3 = Addition(A=complex_3, B=complex_4)
subtraction_2 = Subtraction(A=complex_8.Real, B=complex_7.Real)
subtraction_3 = Subtraction(A=complex_8.Imaginary, B=complex_7.Imaginary)
subtraction_4 = Subtraction(A=complex_5.Real, B=complex_6.Real)
subtraction_5 = Subtraction(A=complex_5.Imaginary, B=complex_6.Imaginary)
line_3 = LineSDL(Start=item_6.Item1, Direction=Y, Length=item_3)
line_4 = LineSDL(Start=item_6.Item, Direction=X_2, Length=item_3)
panel_4 = Panel(addition_3)
division = Division(A=subtraction_3, B=subtraction_2)
division_2 = Division(A=subtraction_5, B=subtraction_4)
k2 = Number(division_2)
k1 = Number(division)
multiplication = Multiplication(A=k2, B=complex_6.Real)
multiplication_2 = Multiplication(A=k1, B=complex_7.Real)
panel_5 = Panel(complex_3)
subtraction_6 = Subtraction(A=complex_7.Imaginary, B=multiplication_2)
subtraction_7 = Subtraction(A=complex_6.Imaginary, B=multiplication)
b1 = Number(subtraction_6)
b2 = Number(subtraction_7)
subtraction_8 = Subtraction(A=b2, B=b1)
subtraction_9 = Subtraction(A=k1, B=k2)
dom = ConstructDomain(DomainStart=complex_5.Real, DomainEnd=complex_6.Real)
panel_6 = Panel(dom)
dom_2 = ConstructDomain(DomainStart=complex_8.Real, DomainEnd=complex_7.Real)
panel_7 = Panel(dom_2)
division_3 = Division(A=subtraction_8, B=subtraction_9)
inc = Includes(Value=division_3, Domain=dom_2)  # -> Includes, Deviation
inc_2 = Includes(Value=division_3, Domain=dom)  # -> Includes, Deviation
multiplication_3 = Multiplication(A=division_3, B=k2)
addition_4 = Addition(A=multiplication_3, B=b2)
int_2 = Integer(inc.Includes)
int_3 = Integer(inc_2.Includes)
addition_5 = Addition(A=int_2, B=int_3)
subtraction_10 = Subtraction(A="2", B=addition_5)
extendlinecount = Integer(subtraction_10)
intersection_x = Number(division_3)
intersection_y = Number(addition_4)
xy = XYPlane(Origin=Point(0, 0, 0))
pt_2 = PointOriented(BasePlane=xy, UComponent=intersection_x, VComponent=intersection_y, WComponent=0)
panel_8 = Panel(extendlinecount)
panel_10 = Panel(pt_2)
