# Grasshopper definition 20161017_PE_points_intersection_011_lineDatabase.gh (Grasshopper 0.9.76)

# ----
# log:
# 20161010
# 设计向量方向与数据结构之间的映射关系
# 数据结构用集合运算然后替换
# 替换树形结构的时候需要拍平
# 无论什么情况都留出0123正交的位置为Null
# 如果0123存在，没关系，不存在，插入一个空值
# 20161011
# 角度和path之间的映射关系，以及角度的识别
# 线交的算法与path之间多对多的关系
pi = Pi(Factor="2")
# {0,0}-->0/2*pi
# 0/2*pi <= a< 1/2*pi
# {1,0}-->1/2*pi
# 1/2*pi <= a < 2/2*pi
# {2,0}-->2/2*pi
# 2/2*pi <= a < 3/2*pi
# {3,0}-->3/2*pi
# 3/2*pi <= a < 4/2*pi
# log:
# 20161010
# 如果0123存在，没关系，不存在，插入一个空值
# 光是插入一个空值也是不行，修改标签运算的算法使其更合理:原因是set的时候把null去掉了
# 应该是插入不是替换
# 不是插入一个Null就能解决问题的，问题处在了member的寻找上，寻找时候把null数据给删除了，结果找不到对应的path
random = Random(Range=pi, Number="20", Seed=Slider(33.222, range=0..100))

pi_2 = Pi(Factor=1)
ins = InsertItems(List=random, Item=pi_2, Indices="0", Wrap=True)

# ----
# kernel intersection algorithm 002_siftPoint
panel = Panel("""0
0.4
1
1.5
1.5
1.92

2.05
2.1
2.4
2.3
2.3
2.1
3
3.12
3.11
3.12""")
# Point:indicate a position in space
# Line:length,direction,position
# Point
# two ends of the line
# the intersection of two lines
# the meeting of lines at the corner of a space or volumn
# the center of field
panel_2 = Panel("""0
0.4
1
1.5
1.5
1.92

2.05
2.1
2.4
2.3
2.3
2.1
3
3.12
3.11
3.12""")

# ----
# mapping between angle and path
# {0;0} --> 0
# {1;0} --> 1/2*pi
# {2;0} --> pi
# {3;0} --> 3/2*pi
# 当向量中不存在某正交方向时候为Null
# vectorPath00_can't identify reverse vectors
panel_3 = Panel("2")
pi_3 = Pi(Factor=panel_3)
num = Number(panel)
remap = RemapNumbers(Value=num, Source="4", Target=pi_3)  # -> Mapped, Clipped
pi_4 = Pi(Factor=1)
sort = SortList(Keys=remap.Mapped)  # -> Keys, ValuesA
division = Division(A=pi_4, B="2")
series = Series(Start=0, Step=division, Count="5")
consec = ConsecutiveDomains(Numbers=series, Additive=False)  # -> simplify(Domains)
domain = Domain(graft(consec))
angle = Number(sort.Keys)
dedomain = DeconstructDomain(Domain=domain)  # -> Start, End
larger = LargerThan(FirstNumber=angle, SecondNumber=dedomain.Start)  # -> LargerThan, OrEqualTo
smaller = SmallerThan(FirstNumber=angle, SecondNumber=dedomain.End)  # -> SmallerThan, OrEqualTo
and = GateAnd(A=larger.OrEqualTo, B=smaller.SmallerThan)
sift = SiftPattern(List=angle, SiftPattern=and)  # -> Output0, Output1
clean = CleanTree(RemoveNulls=True, RemoveInvalid=True, RemoveEmpty=False, Tree=sift.Output1)  # -> simplify(Tree)
item = ListItem(List=clean, Index="0", Wrap=True)
equals = Equality(FirstNumber=item, SecondNumber=simplify(dedomain.Start))  # -> Equality, Inequality
int = Integer(equals.Inequality)
ins_2 = InsertItems(List=clean, Indices="0", Wrap=True)
neg = Negative(Value=int)
cull_i = CullIndex(List=ins_2, Indices=neg, Wrap=False)  # -> simplify(List)
num_2 = Number(cull_i)
cset = CreateSet(List=num_2)  # -> Set, Map
addition = Addition(A=cset.Map, B=int)
tstat = TreeStatistics(Tree=addition)  # -> Paths, Length, Count
dpath = DeconstructPath(Branch=tstat.Paths)
graft = GraftTree(Tree=addition, IncludeEmptyLists=True, IncludeNullItems=True)
stack = StackData(Data=dpath, Stack=graft(tstat.Length))
graft_2 = GraftTree(Tree=cull_i, IncludeEmptyLists=True, IncludeNullItems=True)
graft_3 = GraftTree(Tree=stack, IncludeEmptyLists=True, IncludeNullItems=True)  # -> simplify(Tree)
ins_3 = InsertItems(List=graft_3, Item=graft, Indices="-1", Wrap=True)
path = ConstructPath(Indices=ins_3)  # -> simplify(Branch)
viewer = ParamViewer(graft_2)
flatten = FlattenTree(Tree=path, Path="{0}")
flatten_2 = FlattenTree(Tree=cull_i, Path="{0}")
replace = ReplacePaths(Data=graft_2, Search=viewer, Replace=flatten)
graft_4 = GraftTree(Tree=sort.Keys, IncludeEmptyLists=True, IncludeNullItems=True)  # -> simplify(Tree)
keysearch = KeyValueSearch(Keys=flatten_2, Values=flatten, Search=graft_4)

panel_4 = Panel("""0
1
2
3
2
2
3
1
2
1
0
0
2
0
1
3""")

# ----
# log:
# 20161011
# 增强path的排序的算法前馈，可通过path运算直接得到向量关系:
# 排序前后问题：
# 先精确控制还是先离散问题
# 应该是把排序前的原始数据进行path替换，而不是排序之后的数据：结果竟然是一样的。。。！
# 20161017
# 修改好排序过后path下为空值产生的错误
# vectorPath01
# mapping between angle and path
# {0;0} --> 0
# {1;0} --> 1/2*pi
# {2;0} --> pi
# {3;0} --> 3/2*pi
# 无所谓正交向量存不存在
panel_5 = Panel("""0
1
0
1.3
3
1
2.3
2""")
jitter = Jitter(List=panel_4, Jitter=1, Seed=2)  # -> Values, Indices
pi_5 = Pi(Factor=1)
pi_6 = Pi(Factor="2")
num_3 = Number(jitter.Values)
division_2 = Division(A=pi_5, B="2")
# log:
# 20161010
# 不是插入一个Null就能解决问题的，问题处在了member的寻找上，寻找时候把null数据给删除了，结果找不到对应的path:
# 找到替换的member的运算器
# 发现前馈需要一大堆的运算器，先做成后馈
panel_6 = Panel("5")
remap_2 = RemapNumbers(Value=num_3, Source="4", Target=pi_6)  # -> Mapped, Clipped
series_2 = Series(Start=0, Step=division_2, Count=panel_6)
consec_2 = ConsecutiveDomains(Numbers=series_2, Additive=False)  # -> simplify(Domains)
angle_2 = Number(remap_2.Mapped)
domain_2 = Domain(graft(consec_2))
dedomain_2 = DeconstructDomain(Domain=domain_2)  # -> simplify(Start), simplify(End)
larger_2 = LargerThan(FirstNumber=angle_2, SecondNumber=dedomain_2.Start)  # -> LargerThan, OrEqualTo
smaller_2 = SmallerThan(FirstNumber=angle_2, SecondNumber=dedomain_2.End)  # -> SmallerThan, OrEqualTo
and_2 = GateAnd(A=larger_2.OrEqualTo, B=smaller_2.SmallerThan)
sift_2 = SiftPattern(List=angle_2, SiftPattern=and_2)  # -> Output0, Output1
clean_2 = CleanTree(RemoveNulls=True, RemoveInvalid=False, RemoveEmpty=True, Tree=sift_2.Output1)  # -> simplify(Tree)
tstat_2 = TreeStatistics(Tree=clean_2)  # -> Paths, Length, Count
branch = TreeBranch(Tree=dedomain_2.Start, Path=tstat_2.Paths, MaintainPaths=True)
subtraction = Subtraction(A=clean_2, B=branch)
num_4 = Number(clean_2)
eval = Evaluate(F="round(x,4)", x=subtraction)
flatten_3 = FlattenTree(Tree=eval, Path="{0}")
cset_2 = CreateSet(List=flatten_3)  # -> Set, Map
sort_2 = SortList(Keys=cset_2.Set)  # -> Keys, ValuesA
mindex = MemberIndex(Set=sort_2.Keys, Member=eval)  # -> Index, Count
pshift = ShiftPaths(Data=mindex.Index, Offset=-1)
flatten_4 = FlattenTree(Tree=mindex.Index, Path="{0}")
tstat_3 = TreeStatistics(Tree=pshift)  # -> Paths, Length, Count
dpath_2 = DeconstructPath(Branch=tstat_3.Paths)
graft_5 = GraftTree(Tree=flatten_4, IncludeEmptyLists=True, IncludeNullItems=True)  # -> simplify(Tree)
stack_2 = StackData(Data=dpath_2, Stack=graft(tstat_3.Length))
graft_6 = GraftTree(Tree=angle_2, IncludeEmptyLists=True, IncludeNullItems=True)
flatten_5 = FlattenTree(Tree=stack_2, Path="{0}")
graft_7 = GraftTree(Tree=flatten_5, IncludeEmptyLists=True, IncludeNullItems=True)  # -> simplify(Tree)
merge = Merge(Data1=graft_7, Data2=graft_5)
path_2 = ConstructPath(Indices=merge)
graft_8 = GraftTree(Tree=num_4, IncludeEmptyLists=True, IncludeNullItems=True)
flatten_6 = FlattenTree(Tree=path_2, Path="{0}")
flatten_7 = FlattenTree(Tree=graft_8, Path="{0}")
viewer_2 = ParamViewer(graft_8)
keysearch_2 = KeyValueSearch(Keys=flatten_7, Values=flatten_6, Search=graft_6)  # -> simplify(Result)
replace_2 = ReplacePaths(Data=graft_8, Search=viewer_2, Replace=flatten_6)
panel_7 = Panel(replace_2)
panel_8 = Panel(keysearch_2)

panel_9 = Panel("""2.5838678
Pi
1.6421
3.212896
1.5*Pi""")

# ----
# log:
# 20161010
# 应该是插入不是替换：
# 连一个新电池，是True就插入，False就不插入
# 简短的并不需要连接电池
# 插入的应该是一个Null值，而不是正交角度
# instance
panel_10 = Panel("0")
item_2 = ListItem(List=clean, Index=panel_10, Wrap=True)
equals_2 = Equality(FirstNumber=item_2, SecondNumber=simplify(dedomain.Start))  # -> Equality, Inequality
num_5 = Number(clean)
neg_2 = Negative(Value=equals_2.Inequality)
ins_4 = InsertItems(List=num_5, Indices=graft("0"), Wrap=True)
cull_i_2 = CullIndex(List=ins_4, Indices=neg_2, Wrap=False)  # -> simplify(List)

# ----
# log:
# 20161010
# 插入的应该是一个Null值，而不是正交角度:
# 先保留空值，后根据boolean删除Null
# 插入一个空值的方法：
# 运用cull index运算器本身的性质，对布尔值进行negetive后删除不需要的空值
toggle = BooleanToggle(False)
series_3 = Series(Start=0, Step=1, Count=3)  # -> simplify(graft(Series))
graft_9 = GraftTree(Tree="0", IncludeEmptyLists=True, IncludeNullItems=True)  # -> graft(Tree)
panel_11 = Panel([Toggle(False), Toggle(True), toggle])
bool = Boolean(panel_11)
ins_5 = InsertItems(List=series_3, Indices=graft_9, Wrap=True)  # -> simplify(List)
int_2 = Integer(bool)
neg_3 = Negative(Value=int_2)
cull_i_3 = CullIndex(List=ins_5, Indices=graft(neg_3), Wrap=False)
panel_12 = Panel(cull_i_3)

# ----
# log:
# 20161010
# 发现前馈需要一大堆的运算器，先做成后馈
# 如果需要前反馈，可能需要修改标签运算的算法，所以先后馈，至少能做下去
# 重新Partition
# 还是回到前馈
# log:
# 20161010
# 还是回到前馈：
# 用set运算器自带的index记录，与boolean值进行相加，对path运算得到新的path
# log:
# 20161010
# 设计向量方向与数据结构之间的映射关系
# 数据结构用集合运算然后替换
# 替换树形结构的时候需要拍平
# 无论什么情况都留出0123正交的位置为Null
# 如果0123存在，没关系，不存在，插入一个空值
# 20161011
# 角度和path之间的映射关系，以及角度的识别:
# 先正交的位置关系，后自由的位置关系
# 如何识别path知道非正交的相反的向量
# 增强path的排序的算法前馈，可通过path运算直接得到向量关系
panel_13 = Panel(clean)

# ----
# sample_treeStatistics
cset_3 = CreateSet(List=num_2)  # -> Set, Map
tstat_4 = TreeStatistics(Tree=cset_3.Map)  # -> Paths, Length, Count
dpath_3 = DeconstructPath(Branch=tstat_4.Paths)
stack_3 = StackData(Data=dpath_3, Stack=graft(tstat_4.Length))
graft_10 = GraftTree(Tree=cset_3.Map, IncludeEmptyLists=True, IncludeNullItems=True)
graft_11 = GraftTree(Tree=stack_3, IncludeEmptyLists=True, IncludeNullItems=True)  # -> simplify(Tree)
ins_6 = InsertItems(List=graft_11, Item=graft_10, Indices="-1", Wrap=True)
path_3 = ConstructPath(Indices=ins_6)  # -> simplify(Branch)
# DatabaseParameters: A
# B
# C
# k
# a
# b
# random pts
# line
# angle
# distance to origin
# vector
flatten_8 = FlattenTree(Tree=path_3, Path="{0}")

panel_14 = Panel("""0
0.4
1
1.5
1.5
1.92
2
2.05
2.1
2.4
2.3
2.3
2.1
3
3.12
3.11
3.12""")
panel_15 = Panel("""0
1
2
3
2
2
3
1
2
1
0
0
2
0
1
3""")
panel_16 = Panel("""0
1
2
1.3
3
2.3
2""")
line = Line(Line((119.3393443, -60.78584412, 0), (119.6525493, -60.78584412, 0)))
line_2 = Line(Line((119.8096632, -60.78584412, 0), (119.4931182, -60.78584412, 0)))
panel_17 = Panel("""0
1
0
1.3
3
1
2.3
2""")
panel_18 = Panel("运算器存在bug")
ccx = CurveCurve(CurveA=line, CurveB=line_2)  # -> Points, ParamsA, ParamsB

# ----
# mapping between angle and path
# {0;0} --> 0
# {1;0} --> 1/2*pi
# {2;0} --> pi
# {3;0} --> 3/2*pi
# 无所谓正交向量存不存在
jitter_2 = Jitter(List=panel_16, Jitter=1, Seed=2)  # -> Values, Indices
pi_7 = Pi(Factor=1)
pi_8 = Pi(Factor="2")
division_3 = Division(A=pi_7, B="2")
num_6 = Number(jitter_2.Values)
# log:
# 20161011
# 增强path的排序的算法前馈，可通过path运算直接得到向量关系:
# 排序前后问题：
# 先精确控制还是先离散问题
remap_3 = RemapNumbers(Value=num_6, Source="4", Target=pi_8)  # -> Mapped, Clipped
series_4 = Series(Start=0, Step=division_3, Count="5")
consec_3 = ConsecutiveDomains(Numbers=series_4, Additive=False)  # -> simplify(Domains)
angle_3 = Number(remap_3.Mapped)
domain_3 = Domain(graft(consec_3))
dedomain_3 = DeconstructDomain(Domain=domain_3)  # -> simplify(Start), simplify(End)
# log:
# 20161012
# debug时候replacePath爆红:
# 删除空的树形数据结构，merge的时候数据结构对应
# 精度问题导致set不能去掉原本偏差相同的角度：
# 用round函数取到小数点后几位，关键是排序，这样做就不会对原来的数据产生什么影响，是标签改对了
larger_3 = LargerThan(FirstNumber=angle_3, SecondNumber=dedomain_3.Start)  # -> LargerThan, OrEqualTo
smaller_3 = SmallerThan(FirstNumber=angle_3, SecondNumber=dedomain_3.End)  # -> SmallerThan, OrEqualTo
and_3 = GateAnd(A=larger_3.OrEqualTo, B=smaller_3.SmallerThan)
sift_3 = SiftPattern(List=angle_3, SiftPattern=and_3)  # -> Output0, Output1
clean_3 = CleanTree(RemoveNulls=True, RemoveInvalid=False, RemoveEmpty=True, Tree=sift_3.Output1)  # -> simplify(Tree)
tstat_5 = TreeStatistics(Tree=clean_3)  # -> Paths, Length, Count
branch_2 = TreeBranch(Tree=dedomain_3.Start, Path=tstat_5.Paths, MaintainPaths=True)
subtraction_2 = Subtraction(A=clean_3, B=branch_2)
num_7 = Number(clean_3)
eval_2 = Evaluate(F="round(x,4)", x=subtraction_2)
flatten_9 = FlattenTree(Tree=eval_2, Path="{0}")
cset_4 = CreateSet(List=flatten_9)  # -> Set, Map
sort_3 = SortList(Keys=cset_4.Set)  # -> Keys, ValuesA
mindex_2 = MemberIndex(Set=sort_3.Keys, Member=eval_2)  # -> Index, Count
pshift_2 = ShiftPaths(Data=mindex_2.Index, Offset=-1)
flatten_10 = FlattenTree(Tree=mindex_2.Index, Path="{0}")
tstat_6 = TreeStatistics(Tree=pshift_2)  # -> Paths, Length, Count
dpath_4 = DeconstructPath(Branch=tstat_6.Paths)
graft_12 = GraftTree(Tree=flatten_10, IncludeEmptyLists=True, IncludeNullItems=True)  # -> simplify(Tree)
stack_4 = StackData(Data=dpath_4, Stack=graft(tstat_6.Length))
graft_13 = GraftTree(Tree=angle_3, IncludeEmptyLists=True, IncludeNullItems=True)
flatten_11 = FlattenTree(Tree=stack_4, Path="{0}")
graft_14 = GraftTree(Tree=flatten_11, IncludeEmptyLists=True, IncludeNullItems=True)  # -> simplify(Tree)
merge_2 = Merge(Data1=graft_14, Data2=graft_12)
path_4 = ConstructPath(Indices=merge_2)
graft_15 = GraftTree(Tree=num_7, IncludeEmptyLists=True, IncludeNullItems=True)
flatten_12 = FlattenTree(Tree=path_4, Path="{0}")
flatten_13 = FlattenTree(Tree=graft_15, Path="{0}")
viewer_3 = ParamViewer(graft_15)
keysearch_3 = KeyValueSearch(Keys=flatten_13, Values=flatten_12, Search=graft_13)  # -> simplify(Result)
replace_3 = ReplacePaths(Data=graft_15, Search=viewer_3, Replace=flatten_12)
path_5 = DataPath(keysearch_3)
# log:
# 20161010
# 设计向量方向与数据结构之间的映射关系
# 数据结构用集合运算然后替换
# 替换树形结构的时候需要拍平
# 无论什么情况都留出0123正交的位置为Null
# 如果0123存在，没关系，不存在，插入一个空值
# 20161011
# 角度和path之间的映射关系，以及角度的识别:
# 分解basic line的path得到位置位置关系
# 先正交的位置关系，后自由的位置关系
# 考虑先组合line还是先分解path在配对
# 如何识别path知道非正交的相反的向量
# 增强path的排序的算法前馈，可通过path运算直接得到向量关系
# 运用path提取相应的两条交线
# 20161012
# debug时候replacePath爆红
# 精度问题导致set不能去掉原本偏差相同的角度
# 20161017
# 找到了两根交线的关系，先把他放在这，具体怎么用不继续做下去，先考虑其他的大的情况
ultimateangle_afterelection = Number(replace_3)

line_bug_commonline = Line([Line((119.3540923, -60.56923774, 0), (119.5008735, -60.56923774, 0)), Line((119.5919791, -60.56923774, 0), (119.7404475, -60.56923774, 0))])
# debug:之前判断是实交和虚交的方法是判断交点point的x坐标是否在两线段的值域范围内，但是当上述情况的时候，直线会虚交被误判成实际交点
line_bug_insectiononextend = Line([Line((119.0174668, -60.28107794, 0), (119.4638718, -60.28107794, 0)), Line((119.2255633, -60.35451331, 0), (119.2255633, -61.15203638, 0))])
# log:
# 20161010
# 设计向量方向与数据结构之间的映射关系
# 分离对应的算法，让算法之间有通过也有分离
# 线线重合的问题解决后先放在一旁
# 数据结构的替换，在最后做
line_3 = Line([Line((119.5723897, -60.99532941, 0), (119.5723897, -61.13933165, 0)), Line((119.5723897, -60.99532941, 0), (119.7626783, -60.99532941, 0))])
panel_19 = Panel("把正交和斜交的情况分离开来，同时组织数据结构")

# ----
# 00 common parallel
# 10 vectical
# 20 reverse parallel
# 30 vectical
path_6 = DataPath(path_5)
flatten_14 = FlattenTree(Tree=path_6, Path="{0}")
tstat_7 = TreeStatistics(Tree=path_6)  # -> Paths, Length, Count
tstat_8 = TreeStatistics(Tree=path_6)  # -> Paths, Length, Count
ma = MassAddition(Input=tstat_7.Length)  # -> Result, PartialResults
series_5 = Series(Start=0, Step=1, Count=tstat_8.Count)
stack_5 = StackData(Data=ma.PartialResults, Stack=tstat_7.Length)
shift = ShiftList(List=series_5, Shift=stack_5, Wrap=False)
item_3 = ListItem(List=flatten_14, Index=shift, Wrap=True)  # -> simplify(Item)
lng = ListLength(List=item_3)
# log:
# 20161011
# 如何识别path知道非正交的相反的向量
# 增强path的排序的算法前馈，可通过path运算直接得到向量关系
# 运用path提取相应的两条交线；
# 索引交线，并保留原有树形结构
stack_6 = StackData(Data=path_6, Stack=lng)
secondpath = DataPath(item_3)
firstpath = DataPath(stack_6)
dpath_5 = DeconstructPath(Branch=firstpath)
dpath_6 = DeconstructPath(Branch=secondpath)
subtraction_3 = Subtraction(A=dpath_5, B=dpath_6)
abs = Absolute(Value=subtraction_3)
item_4 = ListItem(List=abs, Index=0, Wrap=True)  # -> Item, Item1
panel_20 = Panel("""00
10
20
30""")
ultimateangle_afterelection_2 = Number(ultimateangle_afterelection)
concat = Concatenate(FragmentA=item_4.Item, FragmentB=item_4.Item1)
mindex_3 = MemberIndex(Set=panel_20, Member=concat)  # -> simplify(Index), Count
graft_16 = GraftTree(Tree=secondpath, IncludeEmptyLists=True, IncludeNullItems=True)
graft_17 = GraftTree(Tree=firstpath, IncludeEmptyLists=True, IncludeNullItems=True)

panel_21 = Panel(mindex_3.Index)
panel_22 = Panel("描述方法只是数据结构的不同，先用几何代表抽象的数据结构")
panel_23 = Panel("""多条线且含有多折线连线组织数据结构问题
得到交点
交点的path替换""")
panel_24 = Panel("""x0,y0;0,1,2,3
x1,y0;0,3,2""")
crv = Curve([<curve referenced from the Rhino model> x3])
crv_2 = Curve([<curve referenced from the Rhino model> x3])
explode = Explode(Curve=crv_2, Recursive=True)  # -> Segments, Vertices
end = EndPoints(Curve=crv_2)  # -> Start, End
neg_4 = Negative(Value="1")
shift_2 = ShiftList(List=explode.Vertices, Shift="1", Wrap=False)
shift_3 = ShiftList(List=explode.Vertices, Shift=neg_4, Wrap=False)

panel_25 = Panel("""1,0
0,1
-1,0
0,-1""")
vec = Vector(panel_25)

# ----
# describe space by (point;index) of vector
md_slider = MDSlider(
    slider_value=Point(0.5591201782, 0.4691162109, 0.5),
    SliderMode=0,
    x_domain=Domain(-1000, 1000),
    y_domain=Domain(-1000, 1000),
    z_domain=Domain(0, 1))
panel_26 = Panel("""0
1
2
3""")
line_length = Panel("""3.2
5.1
3.2
5.1""")
line_length_2 = Number(line_length)
int_3 = Integer(panel_26)
lng_2 = ListLength(List=int_3)
series_6 = Series(Start=0, Step=1, Count=lng_2)
item_5 = ListItem(List=vec, Index=int_3, Wrap=True)
item_6 = ListItem(List=line_length_2, Index=series_6, Wrap=True)
basicvectorunit = Vector(item_5)
amp = Amplitude(Vector=basicvectorunit, Amplitude=item_6)
ma_2 = MassAddition(Input=amp)  # -> Result, PartialResults
addition_2 = Addition(A=md_slider, B=ma_2.PartialResults)
pt = Point(addition_2)
shift_4 = ShiftList(List=ma_2.PartialResults, Shift=-1, Wrap=True)
complex = ComplexComponents(Complex=shift_4)  # -> Real, Imaginary
concat_2 = Concatenate(FragmentA=complex.Real, FragmentB=complex.Imaginary, JoinSeparator=",")
pline = PolyLine(Vertices=pt, Closed=True)
concat_3 = Concatenate(FragmentA=concat_2, FragmentB=int_3, JoinSeparator=";")

subtraction_4 = Subtraction(A=shift_2, B=shift_3)

graft_18 = GraftTree(Tree=end.Start, IncludeEmptyLists=True, IncludeNullItems=True)  # -> simplify(Tree)
subtraction_5 = Subtraction(A=graft_18, B="{0,0,0}")  # -> flatten(Result)
item_7 = ListItem(List=subtraction_5, Index="0", Wrap=True)
subtraction_6 = Subtraction(A=graft_18, B=item_7)

unit = UnitVector(Vector=subtraction_4)
vec_2 = Vector(subtraction_4)
len = Length(Curve=explode.Segments)  # -> simplify(Length)
pshift_3 = ShiftPaths(Data=unit, Offset=-1)
mindex_4 = MemberIndex(Set=vec, Member=pshift_3)  # -> Index, Count
vdis = VectorDisplay(Anchor=shift_3, Vector=vec_2)
pshift_4 = ShiftPaths(Data=mindex_4.Index, Offset=-1)  # -> simplify(Data)

vecdirection = Integer(pshift_4)
veclength = Number(len)
pt_2 = Point(graft_18)

panel_27 = Panel(vec)
item_8 = ListItem(List=vec, Index=vecdirection, Wrap=True)
amp_2 = Amplitude(Vector=item_8, Amplitude=veclength)
ma_3 = MassAddition(Input=amp_2)  # -> Result, PartialResults
addition_3 = Addition(A=pt_2, B=ma_3.PartialResults)
pt_3 = Point(addition_3)
ins_7 = InsertItems(List=addition_3, Item=pt_2, Indices="0", Wrap=True)
neg_5 = Negative(Value="1")
panel_28 = Panel(pt_2)
panel_29 = Panel(concat_3)
panel_30 = Panel(amp)
shift_5 = ShiftList(List=ins_7, Shift=neg_5, Wrap=False)  # -> simplify(List)

# ----
# tree data trial
# first point 和 end point 的数据结构组织的方式是同一种的
# 
# 先手工傻做，再寻找规律
# 
# 先不管结构如何，把他们放在一起，结构在外部运算，在替换成对的树形数据
# 上升数据结构后手工或者数列
# 上升后全部拍平处理
# 用stack+listItem对拍平的数据处理
# 
# 留下来的问题是数据结构的替换
# 手工
pt_4 = Point(shift_5)
graft_19 = GraftTree(Tree=pt_4, IncludeEmptyLists=True, IncludeNullItems=True)

flatten_15 = FlattenTree(Tree=graft_19, Path="{0}")
tstat_9 = TreeStatistics(Tree=pt_4)  # -> Paths, Length, Count
tstat_10 = TreeStatistics(Tree=graft_19)  # -> Paths, Length, Count
ma_4 = MassAddition(Input=tstat_9.Length)  # -> Result, PartialResults
series_7 = Series(Start=0, Step=1, Count=tstat_10.Count)
stack_7 = StackData(Data=ma_4.PartialResults, Stack=tstat_9.Length)
shift_6 = ShiftList(List=series_7, Shift=stack_7, Wrap=False)
item_9 = ListItem(List=flatten_15, Index=shift_6, Wrap=True)  # -> simplify(Item)

lng_3 = ListLength(List=item_9)

bang = ExplodeTree(Data=graft_19)  # -> Branch0, Branch1, Branch2, Branch3, Branch4, Branch5
merge_3 = Merge(Data1=bang.Branch1, Data2=bang.Branch2, Data3=bang.Branch3, Data4=bang.Branch4, Data5=bang.Branch5)
entwine = Entwine(
    Branch00=merge_3,
    Branch01=bang.Branch5,
    Branch02=bang.Branch5,
    Branch03=bang.Branch5,
    Branch04=bang.Branch5,
    FlattenInputs=True)

stack_8 = StackData(Data=graft_19, Stack=lng_3)
shift_7 = ShiftList(List=ins_7, Shift="1", Wrap=False)  # -> simplify(List)
graft_20 = GraftTree(Tree=stack_8, IncludeEmptyLists=True, IncludeNullItems=True)
graft_21 = GraftTree(Tree=shift_5, IncludeEmptyLists=True, IncludeNullItems=True)

flatten_16 = FlattenTree(Tree=graft_21, Path="{0}")
tstat_11 = TreeStatistics(Tree=shift_5)  # -> Paths, Length, Count
tstat_12 = TreeStatistics(Tree=graft_21)  # -> Paths, Length, Count
ma_5 = MassAddition(Input=tstat_11.Length)  # -> Result, PartialResults
series_8 = Series(Start=0, Step=1, Count=tstat_12.Count)
stack_9 = StackData(Data=ma_5.PartialResults, Stack=tstat_11.Length)
shift_8 = ShiftList(List=series_8, Shift=stack_9, Wrap=False)
viewer_4 = ParamViewer()
item_10 = ListItem(List=flatten_16, Index=shift_8, Wrap=True)  # -> simplify(Item)
replace_4 = ReplacePaths(Data=item_10, Search=viewer_4)

graft_22 = GraftTree(Tree=shift_7, IncludeEmptyLists=True, IncludeNullItems=True)

# ----
# kernel tree data
flatten_17 = FlattenTree(Tree=graft_22, Path="{0}")
tstat_13 = TreeStatistics(Tree=shift_7)  # -> Paths, Length, Count
tstat_14 = TreeStatistics(Tree=graft_22)  # -> Paths, Length, Count
ma_6 = MassAddition(Input=tstat_13.Length)  # -> Result, PartialResults
series_9 = Series(Start=0, Step=1, Count=tstat_14.Count)
stack_10 = StackData(Data=ma_6.PartialResults, Stack=tstat_13.Length)
shift_9 = ShiftList(List=series_9, Shift=stack_10, Wrap=False)
item_11 = ListItem(List=flatten_17, Index=shift_9, Wrap=True)  # -> simplify(Item)
viewer_5 = ParamViewer()
replace_5 = ReplacePaths(Data=item_11, Search=viewer_5)

addition_4 = Addition(A=pt_2)

viewer_6 = ParamViewer()
replace_6 = ReplacePaths(Data=item_9, Search=viewer_6)

firstpt_line0 = Point(graft_21)
firstpt_line1 = Point(item_10)
endpt_line0 = Point(graft_22)
endpt_line1 = Point(item_11)

graft_23 = GraftTree(Tree=item_9, IncludeEmptyLists=True, IncludeNullItems=True)

# ----
# explore a point position in space
line_4 = Line([Line((120.4046894, -60.83579072, 0), (120.4046894, -60.79145643, 0)), Line((120.3917346, -60.82485109, 0), (120.420811, -60.82485109, 0))])
panel_31 = Panel("""处理k不存在的情况

写成函数
把坐标在相减后就分开来算

对实交和虚交的算法 不够缜密""")
# debug:可以做，但是要改动很多，先放放，出现问题了再来
linelist = Curve(line_4)
end_2 = EndPoints(Curve=linelist)  # -> Start, End
subtraction_7 = Subtraction(A=end_2.End, B=end_2.Start)
xy = XYPlane(Origin=Point(0, 0, 0))

startpoint = Point(end_2.Start)
vec_3 = Vector(subtraction_7)

addition_5 = Addition(A=startpoint, B=vec_3)
endpoint = Point(addition_5)
lng_4 = ListLength(List=addition_5)
lng_5 = ListLength(List=startpoint)
subtraction_8 = Subtraction(A=lng_4, B="1")
subtraction_9 = Subtraction(A=lng_5, B="1")
series_10 = Series(Start=0, Step=1, Count=subtraction_9)
series_11 = Series(Start=0, Step=1, Count=subtraction_8)
addition_6 = Addition(A=series_10, B="1")
addition_7 = Addition(A=series_11, B="1")
item_12 = ListItem(List=startpoint, Index=series_10, Wrap=False)  # -> simplify(graft(Item))
item_13 = ListItem(List=addition_5, Index=series_11, Wrap=False)  # -> simplify(graft(Item))
shift_10 = ShiftList(List=addition_5, Shift=addition_7, Wrap=False)  # -> simplify(List)
shift_11 = ShiftList(List=startpoint, Shift=addition_6, Wrap=False)  # -> simplify(List)

firstpt_line0_2 = Point(item_12)
firstpt_line1_2 = Point(shift_11)
endpt1_line1 = Point(shift_10)
endpt_line0_2 = Point(item_13)

points = PointList(Points=flatten(firstpt_line0_2), Size=Slider(6, range=0..100))

complex_2 = ComplexComponents(Complex=firstpt_line0_2)  # -> Real, Imaginary
complex_3 = ComplexComponents(Complex=endpt_line0_2)  # -> Real, Imaginary
complex_4 = ComplexComponents(Complex=firstpt_line1_2)  # -> Real, Imaginary
complex_5 = ComplexComponents(Complex=endpt1_line1)  # -> Real, Imaginary
subtraction_10 = Subtraction(A=complex_4.Imaginary, B=complex_5.Imaginary)
subtraction_11 = Subtraction(A=complex_4.Real, B=complex_5.Real)
subtraction_12 = Subtraction(A=complex_2.Real, B=complex_3.Real)
subtraction_13 = Subtraction(A=complex_2.Imaginary, B=complex_3.Imaginary)
division_4 = Division(A=subtraction_10, B=subtraction_11)
division_5 = Division(A=subtraction_13, B=subtraction_12)
k2 = Number(division_4)
multiplication = Multiplication(A=k2, B=complex_4.Real)
subtraction_14 = Subtraction(A=complex_4.Imaginary, B=multiplication)
k1 = Number(division_5)
b2 = Number(subtraction_14)
subtraction_15 = Subtraction(A=k1, B=k2)

multiplication_2 = Multiplication(A=k1, B=complex_2.Real)
subtraction_16 = Subtraction(A=complex_2.Imaginary, B=multiplication_2)

equals_3 = Equality(FirstNumber=subtraction_11, SecondNumber="0")  # -> Equality, Inequality
equals_4 = Equality(FirstNumber=subtraction_12, SecondNumber="0")  # -> Equality, Inequality
sift_4 = SiftPattern(List=complex_5.Real, SiftPattern=equals_3.Equality)  # -> Output0, Output1
sift_5 = SiftPattern(List=complex_2.Real, SiftPattern=equals_4.Equality)  # -> Output0, Output1
or = GateOr(A=equals_4.Equality, B=equals_3.Equality)
combine = CombineData(Input0=sift_5.Output1, Input1=sift_4.Output1)  # -> Result, Index
sift_6 = SiftPattern(List=k2, SiftPattern=equals_3.Equality)  # -> Output0, Output1
sift_7 = SiftPattern(List=b2, SiftPattern=equals_3.Equality)  # -> Output0, Output1
sift_8 = SiftPattern(List=k1, SiftPattern=equals_4.Equality)  # -> Output0, Output1
combine_2 = CombineData(Input0=sift_8.Output0, Input1=sift_6.Output0)  # -> Result, Index
a = Number(combine.Result)
k = Number(combine_2.Result)
multiplication_3 = Multiplication(A=a, B=k)
intersection_x = Number(a)

b1 = Number(subtraction_16)
subtraction_17 = Subtraction(A=b2, B=b1)
division_6 = Division(A=subtraction_17, B=subtraction_15)
multiplication_4 = Multiplication(A=division_6, B=k2)
addition_8 = Addition(A=multiplication_4, B=b2)
sift_9 = SiftPattern(List=addition_8, SiftPattern=or)  # -> Output0, Output1

sift_10 = SiftPattern(List=b1, SiftPattern=equals_4.Equality)  # -> Output0, Output1
combine_3 = CombineData(Input0=sift_10.Output0, Input1=sift_7.Output0)  # -> Result, Index
b = Number(combine_3.Result)
sift_11 = SiftPattern(List=b, SiftPattern=or)  # -> Output0, Output1
addition_9 = Addition(A=multiplication_3, B=sift_11.Output1)
intersection_y = Number(addition_9)

combine_4 = CombineData(Input0=sift_9.Output0, Input1=intersection_y)  # -> Result, Index
combine_5 = CombineData(Input0=division_6, Input1=intersection_x)  # -> Result, Index

panel_32 = Panel(equals_4.Equality)
intersection_x_2 = Number(combine_5.Result)
intersection_y_2 = Number(combine_4.Result)
pt_5 = PointOriented(BasePlane=xy, UComponent=intersection_x_2, VComponent=intersection_y_2, WComponent=0)

# ----
# true --> real insection
# false --> extend
# 10,11 --> real insection
# 01       --> extend one line
# 00       --> extend two lines
# true   -- > extend one line
# false -->  extend two lines
dom = ConstructDomain(DomainStart=complex_2.Imaginary, DomainEnd=complex_3.Imaginary)
dom_2 = ConstructDomain(DomainStart=complex_2.Real, DomainEnd=complex_3.Real)
dom_3 = ConstructDomain(DomainStart=complex_4.Real, DomainEnd=complex_5.Real)
dom_4 = ConstructDomain(DomainStart=complex_4.Imaginary, DomainEnd=complex_5.Imaginary)
firstpty_domain = Domain(dom)
firstptx_domain = Domain(dom_2)
endpty_domain = Domain(dom_4)
endptx_domain = Domain(dom_3)
inc = Includes(Value=intersection_y_2, Domain=firstpty_domain)  # -> Includes, Deviation
inc_2 = Includes(Value=intersection_x_2, Domain=endptx_domain)  # -> Includes, Deviation
inc_3 = Includes(Value=intersection_y_2, Domain=endpty_domain)  # -> Includes, Deviation
inc_4 = Includes(Value=intersection_x_2, Domain=firstptx_domain)  # -> Includes, Deviation
or_2 = GateOr(A=inc_4.Includes, B=inc.Includes, C=inc_2.Includes, D=inc_3.Includes)
and_4 = GateAnd(A=inc_4.Includes, B=inc.Includes, C=inc_2.Includes, D=inc_3.Includes)
int_4 = Integer(and_4)
int_5 = Integer(or_2)
concat_4 = Concatenate(FragmentA=int_4, FragmentB=int_5)
panel_33 = Panel("""10
11
01
00""")
panel_34 = Panel("""0
0
1
2""")
keysearch_4 = KeyValueSearch(Keys=panel_33, Values=panel_34, Search=concat_4)
extendlinecount = Integer(keysearch_4)

sift_12 = SiftPattern(List=pt_5, SiftPattern=extendlinecount)  # -> Output0, Output1, Output2
intersectionontwolines = Point(sift_12.Output0)
intersectionononeline = Point(sift_12.Output1)
intersectiononextend = Point(sift_12.Output2)
panel_35 = Panel(intersectionontwolines)

firstpt0 = Point(firstpt_line0)
firstpt1 = Point(firstpt_line1)
endpt0 = Point(endpt_line0)
endpt1 = Point(endpt_line1)
points_2 = PointList(Points=flatten(firstpt0), Size=Slider(0.109, range=0..3))
complex_6 = ComplexComponents(Complex=firstpt0)  # -> Real, Imaginary
complex_7 = ComplexComponents(Complex=firstpt1)  # -> Real, Imaginary
complex_8 = ComplexComponents(Complex=endpt1)  # -> Real, Imaginary
complex_9 = ComplexComponents(Complex=endpt0)  # -> Real, Imaginary
subtraction_18 = Subtraction(A=complex_7.Imaginary, B=complex_8.Imaginary)
subtraction_19 = Subtraction(A=complex_7.Real, B=complex_8.Real)
equals_5 = Equality(FirstNumber=subtraction_19, SecondNumber="0")  # -> Equality, Inequality
sift_13 = SiftPattern(List=complex_8.Real, SiftPattern=equals_5.Equality)  # -> Output0, Output1
subtraction_20 = Subtraction(A=complex_6.Imaginary, B=complex_9.Imaginary)
subtraction_21 = Subtraction(A=complex_6.Real, B=complex_9.Real)
equals_6 = Equality(FirstNumber=subtraction_21, SecondNumber="0")  # -> Equality, Inequality
sift_14 = SiftPattern(List=complex_6.Real, SiftPattern=equals_6.Equality)  # -> Output0, Output1
or_3 = GateOr(A=equals_6.Equality, B=equals_5.Equality)
combine_6 = CombineData(Input0=sift_14.Output1, Input1=sift_13.Output1)  # -> Result, Index
division_7 = Division(A=subtraction_18, B=subtraction_19)
division_8 = Division(A=subtraction_20, B=subtraction_21)
panel_36 = Panel("""处理k不存在的情况

写成函数
把坐标在相减后就分开来算""")
k2_2 = Number(division_7)
multiplication_5 = Multiplication(A=k2_2, B=complex_7.Real)
sift_15 = SiftPattern(List=k2_2, SiftPattern=equals_5.Equality)  # -> Output0, Output1
subtraction_22 = Subtraction(A=complex_7.Imaginary, B=multiplication_5)
k1_2 = Number(division_8)
multiplication_6 = Multiplication(A=k1_2, B=complex_6.Real)
sift_16 = SiftPattern(List=k1_2, SiftPattern=equals_6.Equality)  # -> Output0, Output1
subtraction_23 = Subtraction(A=complex_6.Imaginary, B=multiplication_6)
combine_7 = CombineData(Input0=sift_16.Output0, Input1=sift_15.Output0)  # -> Result, Index
b1_2 = Number(subtraction_23)
sift_17 = SiftPattern(List=b1_2, SiftPattern=equals_6.Equality)  # -> Output0, Output1
b2_2 = Number(subtraction_22)
sift_18 = SiftPattern(List=b2_2, SiftPattern=equals_5.Equality)  # -> Output0, Output1
combine_8 = CombineData(Input0=sift_17.Output0, Input1=sift_18.Output0)  # -> Result, Index
subtraction_24 = Subtraction(A=b2_2, B=b1_2)
b_2 = Number(combine_8.Result)
a_2 = Number(combine_6.Result)
k_2 = Number(combine_7.Result)
subtraction_25 = Subtraction(A=k1_2, B=k2_2)
sift_19 = SiftPattern(List=b_2, SiftPattern=or_3)  # -> Output0, Output1
multiplication_7 = Multiplication(A=a_2, B=k_2)
division_9 = Division(A=subtraction_24, B=subtraction_25)
multiplication_8 = Multiplication(A=division_9, B=k2_2)
addition_10 = Addition(A=multiplication_8, B=b2_2)
sift_20 = SiftPattern(List=addition_10, SiftPattern=or_3)  # -> Output0, Output1
addition_11 = Addition(A=multiplication_7, B=sift_19.Output1)
intersection_x_3 = Number(a_2)
intersection_y_3 = Number(addition_11)
combine_9 = CombineData(Input0=sift_20.Output0, Input1=intersection_y_3)  # -> Result, Index
combine_10 = CombineData(Input0=division_9, Input1=intersection_x_3)  # -> Result, Index
intersection_x_4 = Number(combine_10.Result)
intersection_y_4 = Number(combine_9.Result)
xy_2 = XYPlane(Origin=Point(0, 0, 0))
pt_6 = PointOriented(BasePlane=xy_2, UComponent=intersection_x_4, VComponent=intersection_y_4, WComponent=0)

# ----
# true --> real insection
# false --> extend
# 10,11 --> real insection
# 01       --> extend one line
# 00       --> extend two lines
# true   -- > extend one line
# false -->  extend two lines
dom_5 = ConstructDomain(DomainStart=complex_6.Imaginary, DomainEnd=complex_9.Imaginary)
dom_6 = ConstructDomain(DomainStart=complex_6.Real, DomainEnd=complex_9.Real)
dom_7 = ConstructDomain(DomainStart=complex_7.Real, DomainEnd=complex_8.Real)
dom_8 = ConstructDomain(DomainStart=complex_7.Imaginary, DomainEnd=complex_8.Imaginary)
firstpty_domain_2 = Domain(dom_5)
firstptx_domain_2 = Domain(dom_6)
endpty_domain_2 = Domain(dom_8)
endptx_domain_2 = Domain(dom_7)
inc_5 = Includes(Value=intersection_y_4, Domain=firstpty_domain_2)  # -> Includes, Deviation
inc_6 = Includes(Value=intersection_x_4, Domain=endptx_domain_2)  # -> Includes, Deviation
inc_7 = Includes(Value=intersection_y_4, Domain=endpty_domain_2)  # -> Includes, Deviation
inc_8 = Includes(Value=intersection_x_4, Domain=firstptx_domain_2)  # -> Includes, Deviation
or_4 = GateOr(A=inc_8.Includes, B=inc_5.Includes, C=inc_6.Includes, D=inc_7.Includes)
and_5 = GateAnd(A=inc_8.Includes, B=inc_5.Includes, C=inc_6.Includes, D=inc_7.Includes)
int_6 = Integer(and_5)
int_7 = Integer(or_4)
concat_5 = Concatenate(FragmentA=int_6, FragmentB=int_7)
panel_37 = Panel("""10
11
01
00""")
panel_38 = Panel("""0
0
1
2""")
keysearch_5 = KeyValueSearch(Keys=panel_37, Values=panel_38, Search=concat_5)
extendlinecount_2 = Integer(keysearch_5)

sift_21 = SiftPattern(List=pt_6, SiftPattern=extendlinecount_2)  # -> Output0, Output1, Output2
intersectiononextend_2 = Point(sift_21.Output2)
intersectionontwolines_2 = Point(sift_21.Output0)
intersectionononeline_2 = Point(sift_21.Output1)

# ----
# 计算点到边界的垂直向量
# describe space by (point;index) of vector
# 问题在于，当某一path缺少时，替换的内容仍然会配对，造成数据多余错误
# 要探测出缺少的路径
# statistics-->DePath
# 最后拍平后替换路径
line_length_3 = Panel("""3.2
5.1
3.2
5.1
6.4
10.2""")
panel_39 = Panel("""0
1
0
1
2
3""")
md_slider_2 = MDSlider(
    slider_value=Point(0.4899997711, 0.4549980164, 0.5),
    SliderMode=0,
    x_domain=Domain(0, 1),
    y_domain=Domain(0, 1),
    z_domain=Domain(0, 1))
panel_40 = Panel("""0
1
2
3""")
line_length_4 = Panel("""3.2
5.1
3.2
5.1""")
panel_41 = Panel("""用字符串的方法表示还差最后一步，那么先拆开来用判断的方法做
拆开的方法很繁琐，索性还是用字符串替换的方法
检查目前的替换方法是否可以简化
并且找出到各个边的距离最近点""")
line_length_5 = Number(line_length_4)
panel_42 = Panel("""1,0
0,1
-1,0
0,-1""")
vec_4 = Vector(panel_42)
int_8 = Integer(panel_40)
lng_6 = ListLength(List=int_8)
series_12 = Series(Start=0, Step=1, Count=lng_6)
item_14 = ListItem(List=vec_4, Index=int_8, Wrap=True)
panel_43 = Panel(item_14)
item_15 = ListItem(List=line_length_5, Index=series_12, Wrap=True)
basicvectorunit_2 = Vector(item_14)
amp_3 = Amplitude(Vector=basicvectorunit_2, Amplitude=item_15)
ma_7 = MassAddition(Input=amp_3)  # -> Result, PartialResults
addition_12 = Addition(A=md_slider_2, B=ma_7.PartialResults)
shift_12 = ShiftList(List=ma_7.PartialResults, Shift=-1, Wrap=True)
complex_10 = ComplexComponents(Complex=shift_12)  # -> Real, Imaginary
concat_6 = Concatenate(FragmentA=complex_10.Real, FragmentB=complex_10.Imaginary, JoinSeparator=",")
item_16 = ListItem(List=amp_3, Index=graft(series_12), Wrap=True)
panel_44 = Panel(ma_7.PartialResults)
concat_7 = Concatenate(FragmentA=concat_6, FragmentB=int_8, JoinSeparator=";")
item_17 = ListItem(List=concat_7, Index=series_12, Wrap=True)
split = TextSplit(Text=item_17, Separators=";")  # -> simplify(Result)
item_18 = ListItem(List=split, Index=0, Wrap=True)  # -> Item, Item1
pt_7 = Point(item_18.Item)
addition_13 = Addition(A=pt_7, B=item_16)
firstpt0_2 = Point(item_18.Item)
endpt0_2 = Point(addition_13)
panel_45 = Panel(concat_7)
complex_11 = ComplexComponents(Complex=endpt0_2)  # -> Real, Imaginary
complex_12 = ComplexComponents(Complex=firstpt0_2)  # -> Real, Imaginary
pt_8 = Point(Point(1.488717773, 12.13872048, 0))
subtraction_26 = Subtraction(A=complex_12.Imaginary, B=complex_11.Imaginary)
subtraction_27 = Subtraction(A=complex_12.Real, B=complex_11.Real)
complex_13 = ComplexComponents(Complex=pt_8)  # -> Real, Imaginary
division_10 = Division(A=subtraction_26, B=subtraction_27)
k1_3 = Number(division_10)
multiplication_9 = Multiplication(A=k1_3, B=complex_11.Real)
subtraction_28 = Subtraction(A=complex_11.Imaginary, B=multiplication_9)
b1_3 = Number(subtraction_28)
panel_46 = Panel("abs(k*x0-y0+b)/sqrt(k*k+1)")
panel_47 = Panel("(k*x0-y0+b)/sqrt(k*k+1)")
panel_48 = Panel("-(k*x0-y0+b)/sqrt(k*k+1)")

x = Number(complex_13.Real)
y = Number(complex_13.Imaginary)
larger_4 = LargerThan(FirstNumber=complex_12.Real, SecondNumber=x)  # -> LargerThan, OrEqualTo
larger_5 = LargerThan(FirstNumber=complex_12.Imaginary, SecondNumber=y)  # -> LargerThan, OrEqualTo
int_9 = Integer(larger_4.LargerThan)
int_10 = Integer(larger_5.LargerThan)
concat_8 = Concatenate(FragmentA=int_9, FragmentB=int_10)

# ---- group: vector match concept Error
panel_49 = Panel("""010
012
110
112""")
panel_50 = Panel("""101
103
111
113""")
panel_51 = Panel("""001
003
011
013""")
panel_52 = Panel("""000
002
100
102""")
merge_4 = Merge(Data1=panel_50, Data2=panel_49, Data3=panel_51, Data4=panel_52)
entwine_2 = Entwine(Branch00=panel_50, Branch01=panel_49, Branch02=panel_51, Branch03=panel_52, FlattenInputs=True)  # -> simplify(Result)
concat_9 = Concatenate(FragmentA=concat_8, FragmentB=item_18.Item1)
flatten_18 = FlattenTree(Tree=concat_9, Path="{0}")
mindex_5 = MemberIndex(Set=merge_4, Member=flatten_18)  # -> Index, Count
division_11 = Division(A=mindex_5.Index, B="4")
int_11 = Integer(division_11)
item_19 = ListItem(List=vec_4, Index=int_11, Wrap=True)

# ----
pt_9 = Point(ma_7.PartialResults)
pline_2 = PolyLine(Vertices=pt_9, Closed=True)

# ---- group: vector match concept Error
mindex_6 = MemberIndex(Set=entwine_2, Member=flatten_18)  # -> Index, Count
clean_4 = CleanTree(RemoveNulls=True, RemoveInvalid=True, RemoveEmpty=True, Tree=mindex_6.Index)
tstat_15 = TreeStatistics(Tree=clean_4)  # -> Paths, Length, Count
split_2 = TextSplit(Text=tstat_15.Paths, Separators=";")
item_20 = ListItem(List=split_2, Index="0", Wrap=True)
split_3 = TextSplit(Text=item_20, Separators="{")
item_21 = ListItem(List=split_3, Index="1", Wrap=True)  # -> simplify(Item)

equals_7 = Equality(FirstNumber=graft(flatten_18), SecondNumber=merge_4)  # -> Equality, Inequality
mindex_7 = MemberIndex(Set=equals_7.Equality, Member=Toggle(True))  # -> Index, Count

# ----
# distances between points and space boundary
null = NullItem(Item=k1_3)  # -> NullFlags, InvalidFlags, Description
sift_22 = SiftPattern(List=pt_7, SiftPattern=null.NullFlags)  # -> Output0, Output1
complex_14 = ComplexComponents(Complex=sift_22.Output1)  # -> Real, Imaginary
eval_3 = Evaluate(F="abs(k*x0-y0+b)/sqrt(k*k+1)", k=k1_3, b=b1_3, x0=complex_13.Real, y0=complex_13.Imaginary)
subtraction_29 = Subtraction(A=complex_13.Real, B=complex_14.Real)  # -> simplify(Result)
distance = Number(eval_3)
abs_2 = Absolute(Value=subtraction_29)  # -> simplify(Result)
combine_11 = CombineData(Input0=distance, Input1=abs_2)  # -> Result, Index

# ---- group: vector match method 1
concat_10 = Concatenate(FragmentA=concat_8, FragmentB=item_18.Item1)
flatten_19 = FlattenTree(Tree=concat_10, Path="{0}")
panel_53 = Panel("""000
002
100
102""")
panel_54 = Panel("""101
103
111
113""")
panel_55 = Panel("""010
012
110
112""")
panel_56 = Panel("""001
003
011
013""")
mindex_8 = MemberIndex(Set=panel_56, Member=flatten_19)  # -> Index, Count
mindex_9 = MemberIndex(Set=panel_53, Member=flatten_19)  # -> Index, Count
mindex_10 = MemberIndex(Set=panel_54, Member=flatten_19)  # -> Index, Count
mindex_11 = MemberIndex(Set=panel_55, Member=flatten_19)  # -> Index, Count
clean_5 = CleanTree(RemoveNulls=True, RemoveInvalid=True, RemoveEmpty=True, Tree=mindex_11.Index)
clean_6 = CleanTree(RemoveNulls=True, RemoveInvalid=True, RemoveEmpty=True, Tree=mindex_9.Index)
clean_7 = CleanTree(RemoveNulls=True, RemoveInvalid=True, RemoveEmpty=True, Tree=mindex_10.Index)
clean_8 = CleanTree(RemoveNulls=True, RemoveInvalid=True, RemoveEmpty=True, Tree=mindex_8.Index)
replace_7 = ReplaceItems(List=clean_7, Item="0", Indices="0", Wrap=False)
replace_8 = ReplaceItems(List=clean_5, Item="1", Indices="0", Wrap=False)
replace_9 = ReplaceItems(List=clean_8, Item="2", Indices="0", Wrap=False)
replace_10 = ReplaceItems(List=clean_6, Item="3", Indices="0", Wrap=False)
merge_5 = Merge(Data1=replace_7, Data2=replace_8, Data3=replace_9, Data4=replace_10)
item_22 = ListItem(List=vec_4, Index=merge_5, Wrap=True)
amp_4 = Amplitude(Vector=item_22, Amplitude=combine_11.Result)
vdis_2 = VectorDisplay(Anchor=pt_8, Vector=amp_4)

# ---- group: vector match method 0 Error
# left-down;x-axis
# left-up;y-axis
a_3 = Number(complex_12.Real)
y_2 = Number(complex_13.Imaginary)
x_2 = Number(complex_13.Real)
b_3 = Number(complex_12.Imaginary)
item_23 = ListItem(List=vec_4, Index=item_18.Item1, Wrap=True)
smaller_4 = SmallerThan(FirstNumber=b_3, SecondNumber=y_2)  # -> SmallerThan, OrEqualTo
not = GateNot(A=smaller_4.SmallerThan)
smaller_5 = SmallerThan(FirstNumber=a_3, SecondNumber=x_2)  # -> SmallerThan, OrEqualTo
and_6 = GateAnd(A=smaller_5.SmallerThan, B=not)
equals_8 = Equality(FirstNumber="0", SecondNumber=graft(int_8))  # -> Equality, Inequality
equals_9 = Equality(FirstNumber="2", SecondNumber=graft(int_8))  # -> Equality, Inequality
and_7 = GateAnd(A=smaller_5.SmallerThan, B=smaller_4.SmallerThan)
equals_10 = Equality(FirstNumber="1", SecondNumber=graft(int_8))  # -> Equality, Inequality
equals_11 = Equality(FirstNumber="3", SecondNumber=graft(int_8))  # -> Equality, Inequality
or_5 = GateOr(A=equals_8.Equality, B=equals_9.Equality)
or_6 = GateOr(A=equals_10.Equality, B=equals_11.Equality)
and_8 = GateAnd(A=or_6, B=and_7)
and_9 = GateAnd(A=or_5, B=and_6)
or_7 = GateOr(A=and_8, B=and_9)
sift_23 = SiftPattern(List=item_23, SiftPattern=or_7)  # -> Output0, Output1
pi_9 = Pi(Factor="0.5")
Z = UnitZ(Factor=1)
neg_6 = Negative(Value=pi_9)
vrot = Rotate(Vector=sift_23.Output0, Axis=Z, Angle=neg_6)
vrot_2 = Rotate(Vector=sift_23.Output1, Axis=Z, Angle=pi_9)
combine_12 = CombineData(Input0=vrot, Input1=vrot_2)  # -> Result, Index
amp_5 = Amplitude(Vector=combine_12.Result, Amplitude=combine_11.Result)
vdis_3 = VectorDisplay(Anchor=pt_8, Vector=amp_5)

# ----
# vectors between points and space boundary
panel_57 = Panel("0.5")  # disabled
item_24 = ListItem(List=vec_4, Index=item_18.Item1, Wrap=True)  # disabled
pi_10 = Pi(Factor=panel_57)  # disabled
neg_7 = Negative(Value=pi_10)  # disabled
Z_2 = UnitZ(Factor=1)  # disabled
vrot_3 = Rotate(Vector=item_24, Axis=Z_2, Angle=neg_7)  # disabled
amp_6 = Amplitude(Vector=vrot_3, Amplitude=combine_11.Result)  # disabled

panel_58 = Panel(eval_3)
panel_59 = Panel(combine_11.Result)

# ---- group: vector match method 1 simplify
entwine_3 = Entwine(Branch00=panel_50, Branch01=panel_49, Branch02=panel_51, Branch03=panel_52, FlattenInputs=True)  # -> simplify(Result)
flatten_20 = FlattenTree(Tree=concat_10, Path="{0}")
mindex_12 = MemberIndex(Set=entwine_3, Member=flatten_20)  # -> Index, Count
clean_9 = CleanTree(RemoveNulls=True, RemoveInvalid=True, RemoveEmpty=True, Tree=mindex_12.Index)
pshift_5 = ShiftPaths(Data=clean_9, Offset=-1)
viewer_7 = ParamViewer(clean_9)

tstat_16 = TreeStatistics(Tree=pshift_5)  # -> Paths, Length, Count
dpath_7 = DeconstructPath(Branch=tstat_16.Paths)  # -> simplify(Indices)

graft_24 = GraftTree(Tree=tstat_16.Length, IncludeEmptyLists=True, IncludeNullItems=True)
series_13 = Series(Start=0, Step=1, Count=graft_24)
int_12 = Integer(simplify(series_13))
replace_11 = ReplaceItems(List=pshift_5, Item=dpath_7, Indices=int_12, Wrap=False)
graft_25 = GraftTree(Tree=flatten(replace_11), IncludeEmptyLists=True, IncludeNullItems=True)
viewer_8 = ParamViewer(graft_25)
replace_12 = ReplacePaths(Data=graft_25, Search=viewer_8, Replace=viewer_7)
pshift_6 = ShiftPaths(Data=replace_12, Offset="1")
item_25 = ListItem(List=vec_4, Index=pshift_6, Wrap=True)
amp_7 = Amplitude(Vector=item_25, Amplitude=combine_11.Result)
vdis_4 = VectorDisplay(Anchor=pt_8, Vector=amp_7)
